% Simulink data dictionary SGKitControllerData.sldd
% references focDemo_Data.sldd

paramEncoderCalibrationDuration = 0.2
paramEncoderCalibrationMaxError = 0.0007853982
paramEncoderRotorPositionAtZeroCount = 0.22933
paramPwmCompareAtZeroVolt = 750
paramPwmCompareMax = 1500
paramPwmComparePerVolt = 62.5
paramEnFluxWeakening = 0
paramKawFluxWeakening = 100
paramKiFluxWeakening = 150
PolePairs = 7
paramEncoderRotorPositionPerCount = 0.0003835
paramCurrentControlI = 200
paramCurrentControlP = 0.5
paramOverCurrentDuration = 0.001
paramCurrentControlSatVoltage = 20
paramAdcAmperePerTransducerVolt = [-15.015015 -15.015015]
paramVelocityControlP = 0.05
paramVelocityControlI = 0.1
paramVelocityFilterCoeffNum = 0.003328
paramVelocityFilterCoeffDen = [1 -0.9967]
paramOverCurrentLimit = 5
paramOpenLoopVelocityAcceleration = 75
paramEncoderCalibrationVoltage = 0.75
paramEncoderCalibrateAtStartup = 1
paramVelocityControlSatCurrent = Simulink.Parameter(4)
paramOpenLoopVelocityToVoltsBias = 0.5
paramOpenLoopVelocityToVoltsScalar = 0.0325
paramOverCurrentEnable = 0
paramAdcTransducerVoltAtZeroAmpere = single([-0.00241875625 0.0235269628])