% Simulink data dictionary SGKitPlantData.sldd
% references focDemo_Data.sldd

pwm = struct(
  TimePerCount=1.333333e-08,
  Period=4.0e-5,
  CounterMax=1500,
  CountPerPeriod=3000,
  AdcTriggerOnTime=5.066667e-07,
  AdcTriggerOnCount=38,
  CountAtZeroVolt=750,
  CountPerVolt=62.5)

encoder = struct(
  Name="Maxon Encoder MILE 651168",
  RotorPositionAtIndex=0.22933,
  ALeadsB=1,
  NumberOfSlits=4096,
  CountPerRevolution=16384,
  RotorPositionResolution=0.0003834952,
  PositionValidAtStartup=true,
  DebounceCount=20)

pmsmInertia = 8.35e-5
pmsmBreakawayFrictionVelocity = 0.01
pmsmBreakawayFrictionTorque = 0.02
pmsmCoulombFrictionTorque = 0.0065
pmsmViscousFrictionCoefficient = 5.35e-5
discInertia = 0

pmsm = struct(
  Name="Maxon EC Motor 625855",
  Description="Maxon EC Motor 625855",
  Units=struct(
    RatedPower="Watt",
    RatedVoltage="Volt",
    RatedSpeed="rad/sec",
    RatedTorque="N m",
    NoLoadSpeed="radian/sec",
    NoLoadCurrent="Ampere",
    StallTorque="N m",
    CurrentMax="Ampere",
    VoltageMax="Volt",
    PolePairs="Pole pair",
    StatorPhaseResistance="Ohm",
    InductanceLd="Henry",
    InductanceLq="Henry",
    InductanceL0="Henry",
    FluxLinkage="Weber",
    Inertia="Kg m^2",
    BreakawayFrictionTorque="N m",
    CoulombFrictionTorque="N m",
    ViscousFrictionCoefficient="N m sec",
    RotorPositionInit="radians",
    RotorVelocityInit="radian/sec",
    TorqueConstant="Nm/A"),
  RatedVoltage=24,
  RatedSpeed=390,
  CurrentMax=5.14,
  VoltageMax=24,
  PolePairs=7,
  StatorPhaseResistance=0.1465,
  InductanceLd=0.0001395,
  InductanceLq=0.0001395,
  InductanceL0=0.0001395,
  FluxLinkage=0.005,
  Inertia=8.35e-5,
  BreakawayFrictionTorque=0.01,
  CoulombFrictionTorque=0.001,
  ViscousFrictionCoefficient=9.0e-5,
  RotorPositionInit=6.155957,
  RotorVelocityInit=0,
  TorqueConstant=0.0525)

boardResistance = 0.43

inverter = struct(
  Name="Speedgoat Inverter PWR-TPI6020",
  BusVoltage=24,
  CurrentMax=2,
  GatesActiveHigh=true,
  GatesComplementary=true)

adc = Simulink.Parameter(struct(
  TransducerVoltPerAmpere=[-0.0666 -0.0666],
  TransducerVoltAtZeroAmpere=single([-0.0020579414 0.0236362629]),
  TransducerVoltPerVolt=0.275,
  TransducerVoltAtZeroVolt=0,
  Bits=16,
  CountMin=0,
  CountMax=32767,
  CountPerTransducerVolt=6399.8046875,
  CountAtZeroTransducerVolt=0,
  ConversionTime=1.0e-6,
  IsSequential=false,
  Delay=0))