% Simulink data dictionary SGMotorData.sldd

encoder = struct(
  Name="Maxon Encoder MILE 651168",
  RotorPositionAtIndex=0.22933,
  ALeadsB=1,
  NumberOfSlits=4096,
  CountPerRevolution=16384,
  RotorPositionResolution=0.0003834952,
  PositionValidAtStartup=true,
  DebounceCount=20)

adc = Simulink.Parameter(struct(
  TransducerVoltPerAmpere=[-0.0666 -0.0666],
  TransducerVoltAtZeroAmpere=single([-0.0020579414 0.0236362629]),
  TransducerVoltPerVolt=0.275,
  TransducerVoltAtZeroVolt=0,
  Bits=16,
  CountMin=0,
  CountMax=32767,
  CountPerTransducerVolt=6399.8046875,
  CountAtZeroTransducerVolt=0,
  ConversionTime=1.0e-6,
  IsSequential=false,
  Delay=0))