% Simulink data dictionary TIKitControllerData.sldd
% references focDemo_Data.sldd

paramCurrentControlI = Simulink.Parameter(200, StorageClass="ExportedGlobal")
paramCurrentControlSatVoltage = 13.85641
paramEncoderCalibrationDuration = 0.2
paramEncoderCalibrationMaxError = 0.0007853982
paramEncoderCalibrationVoltage = 3
paramEncoderRotorPositionAtZeroCount = 0.22933
paramEncoderRotorPositionPerCount = 0.0007854
paramEnFluxWeakening = 0
paramKawFluxWeakening = 100
paramKiFluxWeakening = 150
paramOpenLoopVelocityAcceleration = 40
paramOpenLoopVelocityToVoltsBias = 0.5
paramOpenLoopVelocityToVoltsScalar = 0.05
paramOverCurrentEnable = 0
paramOverCurrentLimit = 5
paramPwmCompareAtZeroVolt = 750
paramPwmCompareMax = 1500
paramPwmComparePerVolt = 62.5
paramVelocityControlD = Simulink.Parameter(0.005, StorageClass="ExportedGlobal")
paramVelocityControlN = Simulink.Parameter(200, StorageClass="ExportedGlobal")
paramVelocityControlP = Simulink.Parameter(0.1, StorageClass="ExportedGlobal")
paramVelocityControlSatCurrent = Simulink.Parameter(4)
PolePairs = 4
paramCurrentControlP = Simulink.Parameter(1, StorageClass="ExportedGlobal")
paramEncoderCalibrateAtStartup = 1
paramOverCurrentDuration = 0.001
paramVelocityControlI = Simulink.Parameter(0.1997169, StorageClass="ExportedGlobal")
paramAdcAmperePerTransducerVolt = 3.636364
paramAdcTransducerVoltAtZeroAmpere = [1.616 1.628]