% Simulink data dictionary TIKitPlantData.sldd
% references focDemo_Data.sldd

pwm = struct(
  TimePerCount=1.333333e-08,
  Period=4.0e-5,
  CounterMax=1500,
  CountPerPeriod=3000,
  AdcTriggerOnTime=5.066667e-07,
  AdcTriggerOnCount=38)

inverter = struct(
  Name="Inverter on Texas Instruments Motor Control Kit Board DRV8312",
  BusVoltage=24,
  CurrentMax=2,
  GatesActiveHigh=true,
  GatesComplementary=true)

discInertia = 9.5e-5

encoder = struct(
  Name="Novi 2: US Digital E3-2000-197-IE",
  RotorPositionAtIndex=0.22933,
  ALeadsB=true,
  NumberOfSlits=2000,
  CountPerRevolution=8000,
  RotorPositionResolution=0.0007854,
  PositionValidAtStartup=true,
  DebounceCount=20)

adc = Simulink.Parameter(struct(
  TransducerVoltPerAmpere=-0.2104262,
  TransducerVoltAtZeroAmpere=1.65,
  TransducerVoltPerVolt=0.275,
  TransducerVoltAtZeroVolt=0,
  Bits=12,
  CountMin=0,
  CountMax=4095,
  CountPerTransducerVolt=1241.212,
  CountAtZeroTransducerVolt=0,
  ConversionTime=1.0e-6,
  IsSequential=false,
  Delay=0))

pmsmInertia = 1.0e-7
pmsmBreakawayFrictionTorque = 0.1
pmsmBreakawayFrictionVelocity = 0.060623
pmsmCoulombFrictionTorque = 0.001
pmsmViscousFrictionCoefficient = 9.0e-5

pmsm = struct(
  Name="Novi 2: BLY171D-24V-4000 Anaheim Automation",
  Description="BLY171D-24V-4000 Anaheim Automation\nPhase A leads B leads C for counterclockwise rotation\n-----------------------------------------------------\nPhase A = Yellow\nPhase B = Red\nPhase C = Black",
  Units=struct(
    RatedPower="Watt",
    RatedVoltage="Volt",
    RatedSpeed="rad/sec",
    RatedTorque="N m",
    NoLoadSpeed="radian/sec",
    NoLoadCurrent="Ampere",
    StallTorque="N m",
    CurrentMax="Ampere",
    VoltageMax="Volt",
    PolePairs="Pole pair",
    StatorPhaseResistance="Ohm",
    InductanceLd="Henry",
    InductanceLq="Henry",
    InductanceL0="Henry",
    FluxLinkage="Weber",
    Inertia="Kg m^2",
    BreakawayFrictionTorque="N m",
    CoulombFrictionTorque="N m",
    ViscousFrictionCoefficient="N m sec",
    RotorPositionInit="radians",
    RotorVelocityInit="radian/sec",
    TorqueConstant="Nm/A"),
  RatedVoltage=24,
  RatedSpeed=418.879,
  CurrentMax=5.4,
  VoltageMax=24,
  PolePairs=4,
  StatorPhaseResistance=0.85565,
  InductanceLd=0.001215,
  InductanceLq=0.001215,
  InductanceL0=0.001215,
  FluxLinkage=0.0065,
  Inertia=3.878e-6,
  BreakawayFrictionTorque=0.0017,
  CoulombFrictionTorque=0.0017,
  ViscousFrictionCoefficient=4.0e-6,
  RotorPositionInit=6.155957,
  RotorVelocityInit=0,
  TorqueConstant=0.026)