% Simulink data dictionary busesDataHIL.sldd
% references focDemo_Data.sldd

controllerInputs = Simulink.Bus()
  motorOn: boolean, Unit="1"
  commandType: Enum: commandTypeEnum, Unit="1"
  velocityCommand: single, Unit="rad/sec"

physicalInputs = Simulink.Bus()
  torqueLoad: double, Unit="N*m"
  connectCurrentSensor: boolean, Unit="1"
  motorBrake: boolean, Unit="1"