% Simulink data dictionary focDemo_Data.sldd

paramCommandType = 3
paramConnectCurrentSensor = true
paramLoadTorqueOzIn = 0
paramMotorBrakeEnable = 0
velCmdVec = [-50 0 50 100]
idxVec = [3 0 1 2]

motorMeasurements = Simulink.Bus()
  phaseCurrentA: double
  phaseCurrentB: double
  phaseCurrentC: double
  directCurrent: double
  quadratureCurrent: double
  electromagneticTorque: double
  rotorPosition: double
  electricalPosition: double
  rotorVelocity: double
  electricalVelocity: double

userInputs = Simulink.Bus()
  torqueLoad: double
  enCurrentSensor: boolean
  motorOn: boolean
  commandType: Enum: commandTypeEnum
  velocityCommand: single

controllerInfo = Simulink.Bus()
  mode: Enum: modeSchedulerEnum
  rotorVelocity: single

motorCommands = Simulink.Bus()
  enInverter: boolean
  pwmCompare: uint16[3]

Sim = Simulink.ConfigSet(StartTime="0", StopTime="inf", Solver="FixedStepAuto", ProdHWDeviceType="Intel->x86-64 (Windows64)", SystemTargetFile="grt.tlc", TargetLang="C")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

controllerFeedback = Simulink.Bus()
  rotorVelocity: single
  transducerVoltage: single[2]
  encoderIndexFound: boolean
  encoderCount: uint16

EC = Simulink.ConfigSet(StartTime="0", StopTime="3", Solver="FixedStepDiscrete", ProdHWDeviceType="Texas Instruments->C2000", SystemTargetFile="ert.tlc", HardwareBoard="TI Piccolo F2806x", TargetLang="C")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

sampleTime = struct(
  CurrentControl=5.0e-5,
  VelocityControl=0.001,
  OpenLoopVelocityControl=5.0e-5,
  OverCurrentDetector=5.0e-5,
  EncoderPosition=5.0e-5,
  EncoderCalibration=5.0e-5)

modeSchedulerEnum = enum(DefaultValue="None")  % Command type enumeration
  None = 0  % mode: Default
  Stand_By = 1  % mode: Standby
  Open_Loop_Command = 2  % mode: Open Loop Velocity Control
  Find_Encoder_Index = 3  % mode: Find Encoder Index
  Calibrate_Encoder_Offset = 4  % mode: Calibrate Encoder Offset
  Closed_Loop = 5  % mode: Closed-Loop Velocity Control
  Error = 6  % mode: Error or Fault State
  Disabled = 7  % mode: Disabled

commandTypeEnum = enum(DefaultValue="Error", AddClassNameToEnumNames=true)  % Command type enumeration
  Error = 0  % Command: Error
  OpenLoop = 1  % Command: Open-loop velocity control
  CalibrateEncoder = 2  % Command: Calibrate encoder
  ClosedLoop = 3  % Command: Closed-Loop velocity control

kitType = 1
SLRT = Simulink.ConfigSet(StartTime="0", StopTime="inf", Solver="FixedStepAuto", ProdHWDeviceType="Intel->x86-64 (Linux 64)", SystemTargetFile="slrealtime.tlc", TargetLang="C++")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