% Simulink data dictionary focHIL_Data.sldd
% references SGKitControllerData.sldd

sampleTimeCurrentControl = Simulink.Parameter(0.0002, Unit="s")
encoderNumberOfSlits = Simulink.Parameter(1024, Unit="1")
pmsmRotorPositionInit = Simulink.Parameter(0, Unit="rad")
SLRT_HIL = Simulink.ConfigSet(StartTime="0", StopTime="4", Solver="FixedStepAuto", ProdHWDeviceType="Generic->32-bit x86 compatible", SystemTargetFile="slrt.tlc", TargetLang="C")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

adcCopy = Simulink.Parameter(struct(
  TransducerVoltPerAmpere=[-0.0666 -0.0666],
  TransducerVoltAtZeroAmpere=single([-0.0020579414 0.0236362629]),
  TransducerVoltPerVolt=0.275,
  TransducerVoltAtZeroVolt=0,
  Bits=16,
  CountMin=0,
  CountMax=32767,
  CountPerTransducerVolt=6399.8046875,
  CountAtZeroTransducerVolt=0,
  ConversionTime=1.0e-6,
  IsSequential=false,
  Delay=0))

pmsm = struct(
  Name="Maxon EC Motor 625855",
  Description="Maxon EC Motor 625855",
  Units=struct(
    RatedPower="Watt",
    RatedVoltage="Volt",
    RatedSpeed="rad/sec",
    RatedTorque="N m",
    NoLoadSpeed="radian/sec",
    NoLoadCurrent="Ampere",
    StallTorque="N m",
    CurrentMax="Ampere",
    VoltageMax="Volt",
    PolePairs="Pole pair",
    StatorPhaseResistance="Ohm",
    InductanceLd="Henry",
    InductanceLq="Henry",
    InductanceL0="Henry",
    FluxLinkage="Weber",
    Inertia="Kg m^2",
    BreakawayFrictionTorque="N m",
    CoulombFrictionTorque="N m",
    ViscousFrictionCoefficient="N m sec",
    RotorPositionInit="radians",
    RotorVelocityInit="radian/sec",
    TorqueConstant="Nm/A"),
  RatedVoltage=24,
  RatedSpeed=390,
  CurrentMax=5.14,
  VoltageMax=24,
  PolePairs=7,
  StatorPhaseResistance=0.1465,
  InductanceLd=0.0001395,
  InductanceLq=0.0001395,
  InductanceL0=0.0001395,
  FluxLinkage=0.005,
  Inertia=8.35e-5,
  BreakawayFrictionTorque=0.01,
  CoulombFrictionTorque=0.001,
  ViscousFrictionCoefficient=9.0e-5,
  RotorPositionInit=6.155957,
  RotorVelocityInit=0,
  TorqueConstant=0.0525)