% Simulink data dictionary adcData.sldd

adcBits = Simulink.Parameter(16, Unit="1")
adcConversionTime = Simulink.Parameter(1.0e-6, Unit="s")
adcCountAtZeroTransducerVolt = Simulink.Parameter(0, Unit="1")
adcCountMax = Simulink.Parameter(32767, Unit="1")
adcCountMin = Simulink.Parameter(0, Unit="1")
adcCountPerTransducerVolt = Simulink.Parameter(1230, Unit="1/V")
adcDelay = Simulink.Parameter(0, Unit="s")
adcIsSequential = Simulink.Parameter(false, DataType="boolean")
adcTransducerVoltAtZeroVolt = Simulink.Parameter(0, Unit="V")
adcTransducerVoltPerVolt = Simulink.Parameter(0.275, Unit="V/V")
adcTransducerVoltPerAmpere = Simulink.Parameter(-0.0667, Unit="V/A")
adcTransducerVoltAtZeroAmpere = Simulink.Parameter([0.0015 0.023], Unit="V")