% Simulink data dictionary busesData.sldd

controllerInputs = Simulink.Bus()
  motorOn: boolean, Unit="1"
  commandType: Enum: commandTypeEnum, Unit="1"
  velocityCommand: single, Unit="rad/sec"

physicalInputs = Simulink.Bus()
  torqueLoad: double, Unit="N*m"
  connectCurrentSensor: boolean, Unit="1"
  motorBrake: boolean, Unit="1"

motorCommands = Simulink.Bus()
  inverterEnable: boolean, Unit="1"
  pwmCompare: uint16[3], Unit="1"

controllerFeedback = Simulink.Bus()
  transducerVoltage: single[2], Unit="V"
  encoderIndexFound: uint16, Unit="1"
  encoderCount: uint16, Unit="1"

motorMeasurements = Simulink.Bus()
  phaseCurrentA: double, Unit="A"
  phaseCurrentB: double, Unit="A"
  phaseCurrentC: double, Unit="A"
  directCurrent: double, Unit="A"
  quadratureCurrent: double, Unit="A"
  electromagneticTorque: double, Unit="N*m"
  rotorPosition: double, Unit="rad"
  electricalPosition: double, Unit="rad"
  rotorVelocity: double, Unit="rad/sec"
  electricalVelocity: double, Unit="rad/sec"

commandTypeEnum = enum(DefaultValue="Error", AddClassNameToEnumNames=true)  % Command type enumeration
  Error = 0  % Command: Error
  OpenLoop = 1  % Command: Open-loop velocity control
  CalibrateEncoder = 2  % Command: Calibrate encoder
  ClosedLoop = 3  % Command: Closed-Loop velocity control