% Simulink data dictionary configData.sldd

pmsmPlantVarObj = Simulink.VariantConfigurationData(
  VariantConfigurations=[struct(
    Name="MCB_PMSM",
    Description="",
    ControlVariables=struct(Name="pmsmPlantVariant", Value="1", Source="pmsmPlantData.sldd"),
    SubModelConfigurations=[]), struct(
    Name="PTBS_PMSM",
    Description="",
    ControlVariables=struct(Name="pmsmPlantVariant", Value="2", Source="pmsmPlantData.sldd"),
    SubModelConfigurations=[]), struct(
    Name="Simscape_PMSM",
    Description="",
    ControlVariables=struct(Name="pmsmPlantVariant", Value="3", Source="pmsmPlantData.sldd"),
    SubModelConfigurations=[])])

MCBPlant = Simulink.Variant(Condition="pmsmPlantVariant == 1")
PTBSPlant = Simulink.Variant(Condition="pmsmPlantVariant == 2")
SimscapePlant = Simulink.Variant(Condition="pmsmPlantVariant == 3")
SLRT = Simulink.ConfigSet(StartTime="0", StopTime="4", Solver="FixedStepAuto", ProdHWDeviceType="Generic->32-bit x86 compatible", SystemTargetFile="slrt.tlc", TargetLang="C")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
pmsmPlantVariant = 3
SLRT_HIL = Simulink.ConfigSet(StartTime="0", StopTime="4", Solver="FixedStepAuto", ProdHWDeviceType="Intel->x86-64 (Linux 64)", SystemTargetFile="slrealtime.tlc", TargetLang="C++")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
sampleTimeCurrentControl = Simulink.Parameter(0.00025, Unit="s")
EC = Simulink.ConfigSet(StartTime="0", StopTime="inf", Solver="FixedStepDiscrete", ProdHWDeviceType="Texas Instruments->C2000", SystemTargetFile="ert.tlc", HardwareBoard="TI Piccolo F2806x", TargetLang="C")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