% Simulink data dictionary controllerData.sldd
% references pwmData.sldd
% references configData.sldd
% references busesData.sldd
% references adcData.sldd
% references encoderData.sldd
% references inverterData.sldd

paramCurrentControlI = Simulink.Parameter(200, Unit="1")
paramOpenLoopVelocityAcceleration = Simulink.Parameter(40, Unit="1")
paramOpenLoopVelocityToVoltsBias = Simulink.Parameter(0.5, Unit="V")
paramOpenLoopVelocityToVoltsScalar = Simulink.Parameter(0.05, Unit="V")
paramOverCurrentEnable = Simulink.Parameter(false, DataType="boolean")
paramOverCurrentLimit = Simulink.Parameter(10, Unit="A")
paramCurrentControlP = Simulink.Parameter(0.5, Unit="1")
paramVelocityControlP = Simulink.Parameter(0.1, Unit="1")
paramVelocityControlI = Simulink.Parameter(0.1, Unit="1")
paramCalibrateAtStartup = Simulink.Parameter(true, DataType="boolean")

modeSchedulerEnum = enum(DefaultValue="None")  % Command type enumeration
  None = 0  % mode: Default
  Stand_By = 1  % mode: Standby
  Open_Loop_Command = 2  % mode: Open Loop Velocity Control
  Find_Encoder_Index = 3  % mode: Find Encoder Index
  Calibrate_Encoder_Offset = 4  % mode: Calibrate Encoder Offset
  Closed_Loop = 5  % mode: Closed-Loop Velocity Control
  Error = 6  % mode: Error or Fault State
  Disabled = 7  % mode: Disabled

paramEncoderRotorPositionAtZeroCount = 0.22933