% Simulink data dictionary encoderData.sldd

encoderCalibrationDuration = Simulink.Parameter(0.2, Unit="s")
encoderRotorPositionAtIndex = Simulink.Parameter(0.5, Unit="rad")
encoderDebounceCount = Simulink.Parameter(20, DataType="uint16", Unit="1")
encoderNumberOfSlits = Simulink.Parameter(1024, Unit="1")
encoderCountPerRevolution = Simulink.Parameter(4096, Unit="1")
encoderName = "MILE Encoder for EC 60 flat"
encoderPositionValidAtStartup = Simulink.Parameter(true, DataType="boolean")
encoderALeadsB = Simulink.Parameter(true, DataType="boolean")
encoderCalibrationVoltage = Simulink.Parameter(5, Unit="V")