% Simulink data dictionary pmsmPlantData.sldd
% references pwmData.sldd
% references configData.sldd
% references busesData.sldd
% references adcData.sldd
% references encoderData.sldd
% references inverterData.sldd

pmsmRatedVoltage = Simulink.Parameter(24, Unit="V")
pmsmRotorPositionInit = Simulink.Parameter(0, Unit="rad")
pmsmRotorVelocityInit = Simulink.Parameter(0, Unit="rad/s")
pmsmVoltageMax = Simulink.Parameter(24, Unit="V")
pmsmVariant = 2
pmsmPolePairs = Simulink.Parameter(7, Unit="1")
pmsmName = "Maxon EC 60 flat"
pmsmNoLoadSpeed = Simulink.Parameter(4300, Unit="rpm")
pmsmNoLoadCurrent = Simulink.Parameter(0.493, Unit="A")
pmsmRatedSpeed = Simulink.Parameter(3730, Unit="rpm")
pmsmRatedCurrent = Simulink.Parameter(5.14, Unit="A")
pmsmStatorPhaseResistance = Simulink.Parameter(0.293, Unit="Ω")
pmsmTorqueConstant = Simulink.Parameter(0.0525, Unit="N*m/A")
discInertia = Simulink.Parameter(8.0e-5, Unit="kg*m*m")
pmsmBreakawayFrictionTorque = Simulink.Parameter(0.1, Unit="N*m")
pmsmBreakawayFrictionVelocity = Simulink.Parameter(0.060623, Unit="rad/s")
pmsmCurrentMax = Simulink.Parameter(5.4, Unit="A")
pmsmInductanceL0 = Simulink.Parameter(0.000279, Unit="H")
pmsmInductanceLd = Simulink.Parameter(0.000279, Unit="H")
pmsmInductanceLq = Simulink.Parameter(0.000279, Unit="H")
pmsmViscousFrictionCoefficient = Simulink.Parameter(9.0e-5, Unit="N*m*s")
pmsmCoulombFrictionTorque = Simulink.Parameter(0.001, Unit="N*m")
pmsmInertia = Simulink.Parameter(8.35e-5, Unit="kg*m*m")