% Simulink data dictionary pwmData.sldd

pwmAdcTriggerOnTime = Simulink.Parameter(5.066667e-07, Unit="s")
pwmComparePerVolt = Simulink.Parameter(62.5, Unit="V")
pwmTimePerCount = Simulink.Parameter(1.333333e-08, Unit="s")
pwmAdcTriggerOnCount = Simulink.Parameter(38, Unit="1")
pwmCountPerPeriod = Simulink.Parameter(3000, DataType="uint16", Unit="1")
pwmCounterMax = Simulink.Parameter(1500, Unit="1")
pwmPeriod = 4.0e-5