% Requirement links of FieldOrientedController.slx (R2020a)

block :1033 implements motorControlRequirements.slreqx#2: State Machine Requirements
block :1033:108 implements motorControlRequirements.slreqx#5: Closed Loop activation
block :1033:375 implements motorControlRequirements.slreqx#4: Standby after Error
block :1033:379 implements motorControlRequirements.slreqx#3: Open Loop Reachability
block :15 implements motorControlRequirements.slreqx#1: Settling time Requirement
block :522 implements motorControlRequirements.slreqx#8: Transducer voltages requirement
block :676 implements motorControlRequirements.slreqx#8: Transducer voltages requirement
block :687 implements motorControlRequirements.slreqx#8: Transducer voltages requirement
block :7 implements motorControlRequirements.slreqx#8: Transducer voltages requirement