% Requirement links of ModeLogicModule.slx (R2019b)

block :1 implements motorControlRequirements.slreqx#2: State Machine Requirements
block :1:162 implements motorControlRequirements.slreqx#5: Closed Loop activation
block :1:375 implements motorControlRequirements.slreqx#4: Standby after Error
block :1:379 implements motorControlRequirements.slreqx#3: Open Loop Reachability
block :1:599 implements motorControlRequirements.slreqx#6: Encoder calibration